% Simulink data dictionary ADCRawToIab.sldd

ComparatorBrkPnt = Simulink.Parameter(Simulink.data.Expression(ExpressionString="[0.0 3.3/2 3.3]"), StorageClass="Const", DataType="fixdt(1,16,2^-4,0)", Min=0, Max=3.3)
DRV_V_REF = Simulink.Parameter(3.3, StorageClass="Define", DataType="fixdt(0,8,2^-4,0)", Min=0, Max=3.3, Unit="V")
VoltageOut = Simulink.Parameter([0.3 0 -0.3], StorageClass="Const", DataType="fixdt(1,16,2^-10,0)", Min=-0.3, Max=0.3, Unit="V")
ADC_RES = Simulink.Parameter(4096, StorageClass="Define", DataType="fixdt(0,16,2^-2,0)", Min=0, Max=4096)
DRV_GAIN = Simulink.Parameter(40, StorageClass="Define", DataType="fixdt(0,8,2^-2,0)", Min=0, Max=40)
CLARKE_CONST = Simulink.Parameter(Simulink.data.Expression(ExpressionString="(1/sqrt(3))"), StorageClass="Define", DataType="fixdt(0,16,2^-12,0)", Min=0, Max=1)
DRV_SHUNTR_OHM = Simulink.Parameter(0.001, StorageClass="Define", DataType="fixdt(0,16,2^-15,0)", Min=0, Max=1, Unit="Ω")
LPF_BETA = Simulink.Parameter(0.1, DataType="fixdt(0,8,0.00392156862745098,0)", Min=0, Max=1)
R = Simulink.Parameter(5, StorageClass="Const", DataType="fixdt(0,8,2^-2,0)", Unit="Ω")
L = Simulink.Parameter(10, StorageClass="Const", DataType="fixdt(0,16,2^-12,0)", Min=0, Max=15, Unit="H")
TimeMS = Simulink.Signal(Unit="ms")
adcBuffer = Simulink.Signal(StorageClass="ImportFromFile", HeaderFile="InterfaceBswApp.h", PreserveDimensions=true, DataType="uint16", Dimensions=2, InitialValue="0")