% Simulink data dictionary CalcSpeednDir.sldd
% references MotorControl.sldd

rad_s = Simulink.Signal(Unit="rad/sec")
rpm = Simulink.Signal(Unit="rpm")
Sig_Angular_Velocity_radpsec_m = Simulink.Signal(StorageClass="ExportedGlobal", Unit="rad/sec")
Sig_rpm = Simulink.Signal(StorageClass="ExportedGlobal", DataType="single")