% Simulink data dictionary SafetyChecks.sldd
% references MotorControl.sldd

MaximumCurrentBeforeReaction = Simulink.Parameter(40, StorageClass="ExportedGlobal", DataType="fixdt(0,16,2^-8,0)", Unit="A")  % Maximum current limit before softare shutdowns the mosfets.
emergency_disable_hardware = Simulink.Signal(StorageClass="GetSet", HeaderFile="InterfaceBswApp.h", SetFunction="emergency_disable_hardware", DataType="boolean")